# Dynamo graph WRITE-CUBED_2EXCEL.dyn (Dynamo 2.1.0.7500)

file_path = Filename(".\Cubes.xls")  # graph input
code_block = CodeBlock { "Sheet1"; }
code_block_2 = CodeBlock { 1; }
code_block_3 = CodeBlock { 4; 5; 6; }
family_types = FamilyTypes("Cube:Cube")  # graph input
all_elements_of_family_type = ElementsOfFamilyType(Family_Type=family_types)
watch = Watch(all_elements_of_family_type)
code_block_4 = CodeBlock { "a"; }
getParameterValueByName = Element.GetParameterValueByName(element=watch, parameterName=code_block_4)
code_block_5 = CodeBlock { "b"; }
getParameterValueByName_2 = Element.GetParameterValueByName(element=watch, parameterName=code_block_5)
code_block_6 = CodeBlock { "c"; }
getParameterValueByName_3 = Element.GetParameterValueByName(element=watch, parameterName=code_block_6)
create = List.Create(item0=getParameterValueByName, item1=getParameterValueByName_2, item2=getParameterValueByName_3)
transpose = List.Transpose(lists=create)
exportExcel = Data.ExportExcel(filePath=file_path, sheetName=code_block, startRow=code_block_2, startCol=code_block_3.out0, data=transpose)
code_block_7 = CodeBlock { "Sheet1"; }
code_block_8 = CodeBlock { 1; }
code_block_9 = CodeBlock { 7; }
location = FamilyInstance.Location(familyInstance=watch)
watch_2 = Watch(location)
exportExcel_2 = Data.ExportExcel(filePath=file_path, sheetName=code_block_7, startRow=code_block_8, startCol=code_block_9, data=watch_2)
code_block_10 = CodeBlock { 3; }
Z = Point.Z(point=location)
exportExcel_3 = Data.ExportExcel(filePath=file_path, sheetName=code_block_7, startRow=code_block_8, startCol=code_block_10, data=Z)
code_block_11 = CodeBlock { 2; }
Y = Point.Y(point=location)
exportExcel_4 = Data.ExportExcel(filePath=file_path, sheetName=code_block_7, startRow=code_block_8, startCol=code_block_11, data=Y)
code_block_12 = CodeBlock { 1; }
X = Point.X(point=location)
exportExcel_5 = Data.ExportExcel(filePath=file_path, sheetName=code_block_7, startRow=code_block_8, startCol=code_block_12, data=X)
